# Grasshopper definition metaballTable.gh (Grasshopper 1.0.7)
# plug-ins: Kangaroo2 Components, LunchBox, Heteroptera

number_slider = Slider(350, range=350..1000)  # disabled
number_slider_2 = Slider(800, range=350..1000)  # disabled
scale = Panel("0.1")  # disabled
pt = Point([Point(279, 218, 0), Point(-181, 218, 0), Point(49, -212, 0)])  # disabled
height = GetNumber(number_slider, AtLeast=1, AtMost=2147483647, Maximum=1.797693135e+308, Minimum=-1.797693135e+308)  # disabled
points = GetPoint(pt, AtLeast=1, AtMost=2147483647, Realtime=True)  # disabled
dimension = GetNumber(number_slider_2, AtLeast=1, AtMost=2147483647, Maximum=1.797693135e+308, Minimum=-1.797693135e+308)  # disabled
# COSTAS E ASSENTO
pt_2 = Point([Point(-276.455631, 163.4911105, 0), Point(-285.8299884, 106.3927518, 0), Point(-76.38284797, 50.27496492, 0), Point(-47.33829445, 44.19432296, 0), Point(-118.362602, -204.4080107, 0), Point(-19.84978102, -197.071809, 0), Point(-15.58870948, -64.12637679, 0)])
# BRAÇOS
pt_3 = Point([Point(-74.75427264, 52.01763765, 0), Point(154.4913765, 132.977997, 0), Point(163.8657339, 104.0027105, 0), Point(122.1072328, -20.42057862, 0), Point(164.7179482, -118.4252242, 0), Point(127.2205186, -148.252725, 0), Point(-25.32584271, -98.82429505, 0)])
number_slider_3 = Slider(2, range=0..10)
points2 = GetPoint(pt_2, AtLeast=1, AtMost=2147483647, Realtime=True)
dom = ConstructDomain(DomainStart=expr("-x/2", dimension), DomainEnd=expr("x/2", dimension))  # disabled
list_item = ListItem(List=pt_3, Index=0, Wrap=True)
deconstruct = Deconstruct(Point=points2)  # -> XComponent, YComponent, ZComponent
points_2 = GetPoint(pt_3, AtLeast=1, AtMost=2147483647, Realtime=True)
Z = UnitZ(Factor=height)  # disabled
rectangle = Rectangle(Plane=PlaneXY(0, 0, 0), XSize=dom, YSize=dom, Radius=0)  # -> Rectangle, Length; disabled
interpolate = Interpolate(Vertices=points_2, Degree=3, Periodic=False, KnotStyle=1)  # -> Curve, Length, Domain
interpolate_2 = Interpolate(Vertices=points2, Degree=3, Periodic=False, KnotStyle=1)  # -> Curve, Length, Domain
interpolate_3 = Interpolate(Vertices=points, Degree=3, Periodic=False, KnotStyle=1)  # -> Curve, Length, Domain; disabled
panel = Panel(deconstruct.XComponent)
panel_2 = Panel(deconstruct.YComponent)
deconstruct_2 = Deconstruct(Point=points_2)  # -> XComponent, YComponent, ZComponent
move = Move(Geometry=rectangle.Rectangle, Motion=Z)  # -> Geometry, Transform; disabled
number_slider_4 = Slider(100, range=0..100)  # disabled
c_script = CSharpScript(crv=interpolate.Curve, color=ColourSwatch(SwatchColor=RGBA(244, 250, 160, 177)))  # -> out, A; inputs crv: Curve, color: Color
# ---------- c_script: C# ----------
    var c = color.R + "," + color.G + "," + color.B;
    crv.SetUserString("color", c);
    A = crv;
# ---------- end c_script ----------

# ---- group: RH_OUT:limit
crv = Curve(rectangle.Rectangle)  # disabled

# ----
c_script_2 = CSharpScript(crv=interpolate_2.Curve, color=ColourSwatch(SwatchColor=RGBA(255, 208, 79, 182)))  # -> out, A; inputs crv: Curve, color: Color; same code as c_script
unit_z = UnitZ(Factor=number_slider_4)  # disabled
move_2 = Move(Geometry=interpolate_3.Curve, Motion=unit_z)  # -> Geometry, Transform; disabled
scale_2 = Scale(Geometry=points, Center=Point(0, 0, 0), Factor=scale)  # -> Geometry, Transform; disabled
scale_3 = Scale(Geometry=move.Geometry, Center=Point(0, 0, 0), Factor=scale)  # -> Geometry, Transform; disabled
panel_3 = Panel("10")  # disabled
panel_4 = Panel(deconstruct_2.XComponent)
panel_5 = Panel(deconstruct_2.YComponent)

# ---- group: RH_OUT:curve
curve = Curve(reparameterize(c_script.A))

# ---- group: RH_OUT:curve2
curve_2 = Curve(reparameterize(c_script_2.A))

# ----
pop2d = Populate2D(Region=scale_3.Geometry, Count=panel_3, Seed=1)  # disabled

# ---- group: RH_OUT:spline
curve_3 = Curve(move_2.Geometry)  # disabled

# ----
item = ListItem(List=pop2d, Index=0, Wrap=True)  # disabled
cp = ClosestPoint(Point=scale_2.Geometry, Cloud=pop2d)  # -> ClosestPoint, CPIndex, Distance; disabled
number_slider_5 = Slider(17, range=5..25)  # disabled
dimension_2 = GetNumber(Slider(10, range=0..10), AtLeast=1, AtMost=2147483647, Maximum=1.797693135e+308, Minimum=-1.797693135e+308)
construct_domain = Domain(DomainStart=expr("-x/2", dimension_2), DomainEnd=expr("x/2", dimension_2))
construct_domain_2 = Domain(DomainStart=expr("-x/2", dimension_2), DomainEnd=expr("x/2", dimension_2))
pdecon = Deconstruct(Point=item)  # -> XComponent, YComponent, ZComponent; disabled
construct_domain_3 = Domain(DomainStart=expr("-x/2", dimension_2), DomainEnd=expr("x/2", dimension_2))
construct_domain_4 = Domain(DomainStart=expr("-x/2", dimension_2), DomainEnd=expr("x/2", dimension_2))
ln = Line(StartPoint=cp.ClosestPoint, EndPoint=scale_2.Geometry)  # disabled
panel_6 = Panel("0")  # disabled
panel_7 = Panel("10")  # disabled
range = Range(Domain=pdecon.ZComponent, Steps=number_slider_5)  # disabled
ext = ExtendCurve(Curve=ln, Type=0, Start=panel_6, End=panel_7)  # disabled
rectangle_2 = Rectangle(Plane=PlaneXY(0, 0, 0), XSize=construct_domain, YSize=construct_domain_2, Radius=0)  # -> Rectangle, Length
rectangle_3 = Rectangle(Plane=PlaneXY(0, 0, 0), XSize=construct_domain_4, YSize=construct_domain_3, Radius=0)  # -> Rectangle, Length
item_2 = ListItem(List=reverse(range), Index=0, Wrap=True)  # disabled
number_slider_6 = Slider(39.123, range=0..100)  # disabled
number_slider_7 = Slider(2.212, range=0..100)  # disabled
divide = DivideCurve(Curve=ext, Count=10, Kinks=False)  # -> flatten(Points), Tangents, Parameters; disabled
perp_frame = PerpFrame(Curve=curve_2, Parameter=Slider(1, range=0..1))
perp_frame_2 = PerpFrame(Curve=curve, Parameter=Slider(1, range=0..1))
xy_plane = XYPlane(Origin=Point(0, 0, 0))
xy_plane_2 = XYPlane(Origin=Point(0, 0, 0))
lng = ListLength(List=divide.Points)  # disabled
orient = Orient(Geometry=rectangle_2.Rectangle, Source=xy_plane, Target=perp_frame)  # -> Geometry, Transform
orient_2 = Orient(Geometry=rectangle_3.Rectangle, Source=xy_plane_2, Target=perp_frame_2)  # -> Geometry, Transform
dup = DuplicateData(Data=number_slider_6, Number=panel_3, Order=True)  # disabled
dup_2 = DuplicateData(Data=number_slider_7, Number=lng, Order=True)  # disabled
pt_4 = ConstructPoint(XCoordinate=0, YCoordinate=0, ZCoordinate=range)  # disabled
bool = Boolean(lng)  # disabled
sweep1 = Sweep1(Rail=curve_2, Sections=orient.Geometry, Miter=1)
number_slider_8 = Slider(0.506, range=0..1)  # disabled
sweep1_2 = Sweep1(Rail=curve, Sections=orient_2.Geometry, Miter=1)
merge = Merge(Data1=flatten(divide.Points), Data2=flatten(pop2d))  # disabled
center = Center(Geometric=sweep1)  # -> Center, Dimension
center_2 = Center(Geometric=sweep1_2)  # -> Center, Dimension
merge_2 = Merge(Data1=dup_2, Data2=dup)  # disabled
negative = Negative(Value=Slider(90, range=0..360))
filter = StreamFilter(Gate=bool, Stream1=merge_2)  # disabled
xz_plane = XZPlane(Origin=Point(0, 0, 0))
rotate_3d = Rotate3D(Geometry=sweep1_2, Angle=degrees(negative), Center="0,0,0", Axis=xz_plane)  # -> Geometry, Transform
xz_plane_2 = XZPlane(Origin=Point(0, 0, 0))
rotate_3d_2 = Rotate3D(Geometry=sweep1, Angle=degrees(negative), Center="0,0,0", Axis=xz_plane_2)  # -> Geometry, Transform
panel_8 = Panel("10")  # disabled
number_slider_9 = Slider(15, range=1..15)
metaball_t = MetaBallTCustom(Points=merge, Charge=filter, Plane=pt_4, Threshold=number_slider_8)  # disabled
scale_4 = Scale(Geometry=metaball_t, Center=Point(0, 0, 0), Factor=panel_8)  # -> Geometry, Transform; disabled
height_2 = GetNumber(Slider(196, range=0..1000), AtLeast=1, AtMost=2147483647, Maximum=1.797693135e+308, Minimum=-1.797693135e+308)
unit_x = UnitX(Factor=height_2)
move_3 = Move(Geometry=rotate_3d.Geometry, Motion=unit_x)  # -> Geometry, Transform
crv_2 = Curve(simplify(scale_4.Geometry))  # disabled
division = Division(A=height_2, B=dimension_2)
series = Series(Start=Slider(0, range=0..10), Step=dimension_2, Count=division)
unit_x_2 = UnitX(Factor=series)
move_4 = Move(Geometry=rotate_3d_2.Geometry, Motion=unit_x_2)  # -> Geometry, Transform
point = Point(Point(-894.1726251, 0.6635282794, 0))
explode = Explode(Curve=crv_2, Recursive=True)  # -> flatten(Segments), Vertices; disabled
vector_2pt = Vector2Pt(PointA=center_2.Center, PointB=point, Unitize=False)  # -> Vector, Length
vector_2pt_2 = Vector2Pt(PointA=center_2.Center, PointB=point, Unitize=False)  # -> Vector, Length
dupln = RemoveDuplicateLines(Lines=explode.Segments, Tolerance=0.01)  # disabled
move_5 = Move(Geometry=[move_3.Geometry, rotate_3d.Geometry], Motion=vector_2pt.Vector)  # -> Geometry, Transform

number_slider_10 = Slider(767, range=0..1000)
number_slider_11 = Slider(767, range=0..1000)
number_slider_12 = Slider(3, range=0..10)
list_length = ListLength(List=move_4.Geometry)
division_2 = Division(A=list_length, B=number_slider_12)
point_2 = Point(Point(-7.377182708, 902.1359661, 0))
dom_2 = Domain(DomainStart=expr("-x/2", number_slider_10), DomainEnd=expr("x/2", number_slider_10))
dom_3 = Domain(DomainStart=expr("-x/2", number_slider_11), DomainEnd=expr("x/2", number_slider_11))
center_3 = Center(Geometric=move_4.Geometry)  # -> Center, Dimension
rectangle_4 = Rectangle(Plane=point_2, XSize=dom_2, YSize=dom_3, Radius=0)  # -> Rectangle, Length
grid_structure = GridStructure(Surface=rectangle_4.Rectangle, UDivisions=division_2, VDivisions=number_slider_12)  # -> StructureLines, StructureNodes
# PLANIFICACAO
yz_plane = YZPlane(Origin=center_3.Center)
layout_points = Point(grid_structure.StructureNodes)
short = ShortestList(ListA=move_4.Geometry, ListB=layout_points, TrimMode=2)  # -> ListA, ListB
orient_3 = Orient(Geometry=move_4.Geometry, Source=yz_plane, Target=short.ListB)  # -> Geometry, Transform
series_2 = Series(Start=0, Step=1, Count=Slider(20, range=0..100))
tag = TextTag3D(Location=short.ListB, Text=series_2, Size=Slider(56, range=0..100), Justification=8)

join = JoinCurves(Curves=dupln, Preserve=False)  # disabled
move_6 = Move(Geometry=move_4.Geometry, Motion=vector_2pt_2.Vector)  # -> Geometry, Transform
list_item_2 = ListItem(List=move_4.Geometry, Index=0, Wrap=True)
number_slider_13 = Slider(767, range=0..1000)
number_slider_14 = Slider(767, range=0..1000)
center_4 = Center(Geometric=list_item_2)  # -> Center, Dimension
redpline = Reduce(Polyline=join, Tolerance=1)  # -> Polyline, Reduction; disabled
deconstruct_brep = DeconstructBrep(Brep=move_5.Geometry)  # -> Faces, flatten(Edges), Vertices
midpt = CurveMiddle(Curve=redpline.Polyline)  # disabled
deconstruct_brep_2 = DeconstructBrep(Brep=move_6.Geometry)  # -> Faces, flatten(Edges), Vertices
yz_plane_2 = YZPlane(Origin=center_4.Center)
dom_4 = Domain(DomainStart=expr("-x/2", number_slider_14), DomainEnd=expr("x/2", number_slider_14))
dom_5 = Domain(DomainStart=expr("-x/2", number_slider_14), DomainEnd=expr("x/2", number_slider_14))
dom_6 = Domain(DomainStart=expr("-x/2", number_slider_13), DomainEnd=expr("x/2", number_slider_13))
dom_7 = Domain(DomainStart=expr("-x/2", number_slider_13), DomainEnd=expr("x/2", number_slider_13))
pdecon_2 = Deconstruct(Point=midpt)  # -> XComponent, YComponent, ZComponent; disabled
orient_4 = Orient(Geometry=list_item_2, Source=yz_plane_2, Target=point_2)  # -> Geometry, Transform
bnd = Bounds(Numbers=pdecon_2.ZComponent)  # disabled
rectangle_5 = Rectangle(Plane=point, XSize=dom_4, YSize=dom_5, Radius=0)  # -> Rectangle, Length
rectangle_6 = Rectangle(Plane=PlaneXY(0, 0, 0), XSize=dom_6, YSize=dom_7, Radius=0)  # -> Rectangle, Length
c_script_3 = CSharpScript(crv=[deconstruct_brep_2.Edges, deconstruct_brep.Edges], color=ColourSwatch(SwatchColor=RGB(255, 255, 255)))  # -> out, A; inputs crv: Curve, color: Color; same code as c_script

# ---- group: RH_OUT_mesh2
mesh = Mesh(move_6.Geometry)

# ---- group: RH_OUT:mesh
mesh_2 = Mesh(move_5.Geometry)

# ----
dedomain = DeconstructDomain(Domain=bnd)  # -> Start, End; disabled
bounding_box = BoundingBox(Content=orient_4.Geometry, Plane=PlaneXY(0, 0, 0))  # -> Box, Box_2

# ---- group: RH_OUT:edges2
curve_4 = Curve(c_script_3.A)

# ----
gradient = Gradient(
    LowerLimit=0,
    UpperLimit=dedomain.End,
    Parameter=pdecon_2.ZComponent,
    stops=[0.125: RGB(0, 0, 0), 0.499: RGB(255, 251, 0), 0.868: RGB(255, 0, 255)])  # disabled
deconstruct_brep_3 = DeconstructBrep(Brep=orient_4.Geometry)  # -> Faces, Edges, Vertices
deconstruct_brep_4 = DeconstructBrep(Brep=bounding_box.Box)  # -> Faces, Edges, Vertices
list_item_3 = ListItem(List=deconstruct_brep_4.Edges, Index=0, Wrap=True)  # -> Item, Item1
c_script_4 = CSharpScript(crv=redpline.Polyline, color=gradient)  # -> out, A; inputs crv: Curve, color: Color; disabled; same code as c_script
list_item_4 = ListItem(List=deconstruct_brep_3.Faces, Index=Slider(1, range=0..10), Wrap=True)
preview = CustomPreview(Geometry=redpline.Polyline, Material=gradient)  # disabled
point_on_curve = PointOnCurve(list_item_3.Item1, parameter=0.5)
point_on_curve_2 = PointOnCurve(list_item_3.Item, parameter=0.5)
length = Length(Curve=list_item_3.Item1)

# ---- group: RH_OUT:crvs
crv_3 = Curve(c_script_4.A)  # disabled

# ----
explode_2 = Explode(Curve=list_item_4, Recursive=True)  # -> Segments, Vertices
length_2 = Length(Curve=list_item_3.Item)
number_slider_15 = Slider(767, range=0..1000)
round = Round(Number=length)  # -> Nearest, Floor, Ceiling
round_2 = Round(Number=length_2)  # -> Nearest, Floor, Ceiling
bool_2 = Boolean(True)
bool_3 = Boolean(True)
c_script_5 = CSharpScript(face="Futura", bold=bool_2, size=Slider(30, range=0..100), content=round.Nearest, pl=point_on_curve)  # -> out, A; inputs face: String, bold: Boolean, italics: Boolean, size: Double, content: String, pl: Plane; disabled
# ---------- c_script_5: C# ----------
    if(size == 0)
      size = 1;

    if(!string.IsNullOrEmpty(face) && size > 0 && !string.IsNullOrEmpty(content) &&
      pl.IsValid)
    {

      var te = RhinoDoc.ActiveDoc.Objects.AddText(content, pl, size, face, bold, italics);
      Rhino.DocObjects.TextObject txt = RhinoDoc.ActiveDoc.Objects.Find(te) as Rhino.DocObjects.TextObject;

      if(txt != null)
      {
        var tt = txt.Geometry as Rhino.Geometry.TextEntity;
        A = tt.Explode();
      }
      
      RhinoDoc.ActiveDoc.Objects.Delete(te, true);
    }
# ---------- end c_script_5 ----------
c_script_6 = CSharpScript(crv=explode_2.Segments, color=ColourSwatch(SwatchColor=RGB(255, 255, 255)))  # -> out, A; inputs crv: Curve, color: Color; same code as c_script
curve_5 = Curve(list_item_3.Item)
c_script_7 = CSharpScript(face="Futura", bold=bool_3, size=Slider(30, range=0..100), content=round_2.Nearest, pl=point_on_curve_2)  # -> out, A; inputs face: String, bold: Boolean, italics: Boolean, size: Double, content: String, pl: Plane; disabled; same code as c_script_5
dom_8 = Domain(DomainStart=expr("-x/2", number_slider_15), DomainEnd=expr("x/2", number_slider_15))
dom_9 = Domain(DomainStart=expr("-x/2", number_slider_15), DomainEnd=expr("x/2", number_slider_15))
rotate = Rotate(Geometry=c_script_5.A, Angle=1.570796327, Plane=point_on_curve)  # -> Geometry, Transform
rectangle_7 = Rectangle(Plane=point_2, XSize=dom_8, YSize=dom_9, Radius=0)  # -> Rectangle, Length
curve_6 = Curve(list_item_3.Item1)
number_slider_16 = Slider(11, range=0..100)
unit_y = UnitY(Factor=number_slider_16)
unit_x_3 = UnitX(Factor=number_slider_16)
move_7 = Move(Geometry=[curve_5, c_script_7.A], Motion=expr("-x", unit_y))  # -> flatten(Geometry), Transform
move_8 = Move(Geometry=[curve_6, rotate.Geometry], Motion=unit_x_3)  # -> flatten(Geometry), Transform
colour_swatch = ColourSwatch(SwatchColor=RGB(255, 255, 255))  # disabled
colour_swatch_2 = ColourSwatch(SwatchColor=RGB(255, 255, 255))  # disabled
c_script_8 = CSharpScript(crv=move_7.Geometry, color=colour_swatch)  # -> out, A; inputs crv: Curve, color: Color; disabled; same code as c_script
c_script_9 = CSharpScript(crv=move_8.Geometry, color=colour_swatch_2)  # -> out, A; inputs crv: Curve, color: Color; disabled; same code as c_script
c_script_10 = CSharpScript(
    crv=[rectangle_5.Rectangle, rectangle_6.Rectangle, rectangle_7.Rectangle],
    color=ColourSwatch(SwatchColor=RGB(255, 255, 255)))  # -> out, A; inputs crv: Curve, color: Color; same code as c_script

# ---- group: RH_OUT:plan
curve_7 = Curve(c_script_6.A)  # disabled

# ---- group: RH_OUT:dim2
curve_8 = Curve(c_script_9.A)  # disabled

# ---- group: RH_OUT:dim1
curve_9 = Curve(c_script_8.A)  # disabled

# ---- group: RH_OUT:limit
crv_4 = Curve(c_script_10.A)
